vi "Patr_info_to_str.gvi"   [G Web Development Software 22.3.0]
inputs:
  "Parts_info": "Part_info.gtype"
outputs:
  "Part_info_str": string
types:
  "Part_info.gtype" = cluster{"Part_type": string, "Part_size": string, "Alloys": string[], "Features_list": cluster{"Feature_name": string, "Value": string}[]}
uses:
  NI::G Core::Strings::Search and Replace Pattern.gvi
diagram:
  Property Node(instance in=$Parts_info) -> ("Part_type"=w1, "Part_size"=w2, "Alloys"=w3, "Features_list"=w4)
  for {
    w5 = each element of w4
    Property Node(instance in=w5) -> ("Feature_name"=w7, "Value"=w8)
    Concatenate Strings("-", w7, ": ", w8, "\r\n") -> w9
    append w9 to w6
  }
  Concatenate Strings(w6) -> w10
  w11 = "Деталь: {part_type}\nПлощадь поверхности: {pat_size}\nМатериал детали: {alloys}\nТребуемые свойства\n"
  call "Search and Replace Pattern.gvi"(string=w11, pattern="{part_type}", replace string=w1) -> (result string=w12)
  call "Search and Replace Pattern.gvi"(string=w12, pattern="{pat_size}", replace string=w2) -> (result string=w13)
  Array Size(array=w3) -> (size(s)=w14)
  Decrement(x=w14) -> w15
  for (iteration -> i1) {
    w16 = each element of w3
    Is Equal(x=w15, y=i1) -> w18
    case (w18) {
      frame False, Default {
        Concatenate Strings(w16, ", ") -> w19
      }
      frame True {
        w19 = w16
      }
    }
    append w19 to w17
  }
  Concatenate Strings(w17) -> w20
  call "Search and Replace Pattern.gvi"(string=w13, pattern="{alloys}", replace string=w20) -> (result string=w21)
  Concatenate Strings(w21, w10) -> w22
  $Part_info_str <- w22
