vi "States_history.gvi"   [G Web Development Software 22.3.0]
inputs:
  "Statas": "main_states.gtype" = "Wait_for_event"
outputs:
  "Output": "main_states.gtype"[]
types:
  "main_states.gtype" = enum{"Wait_for_event", "init", "load_aloys", "stop"}
diagram:
  s1 = uninitialised  # shift register
  while {
    Build Array(s1, $Statas) -> w1
    Delete From Array(inArray=w1, length (1)=100, index0=0) -> (deleted=w2)
    next s1 = w2
    stop if TRUE
  }
  $Output <- s1
