vi "index.gviweb"   [G Web Development Software 22.3.0]
panel controls:
  "Part_shape": string
  "Part_size": string
  "Listbox": i32 = -1
  "Select_part": bool
  "Start_analysis": bool
  "Part_info_2": "Part_info.gtype"
panel indicators:
  "Tab": i32
  "Cluster": cluster{"URL Image": string}
  "Error Out": error
  "Part_info_str": string
types:
  "Part_info.gtype" = cluster{"Part_type": string, "Part_size": string, "Alloys": string[], "Features_list": cluster{"Feature_name": string, "Value": string}[]}
uses:
  WebApp::Patr_info_to_str.gvi
  NI::HTTP::GET.gvi
diagram:
  Property Node(instance in=reference to "Listbox", "Items"=["eq", "уц", "уй"])
  s1 = ["init"]  # shift register
  s2 = $Part_info_2  # shift register
  while {
    Delete From Array(inArray=s1, index0=0) -> (outArray=w1, deleted=w2)
    case (w2) {
      frame "Wait_for_event", Default {
        event (timeout = 100) {
          on "Timeout" {
            call "Patr_info_to_str.gvi"(Parts_info=s2) -> (Part_info_str=w6)
            $Part_info_str <- w6
            w3 = w1
            w4 = no error
            w5 = s2
          }
          on "Part_shape" Value changed {
            w7 = "load_part_image"  # main_states
            Build Array(w1, w7) -> w3
            w4 = no error
            w5 = s2
          }
          on "Select_part" Value changed {
            Property Node(instance in=reference to "Part_shape") -> ("ItemsAndValues"=w8, "Value"=w9)
            for {
              w10 = each element of w8
              Property Node(instance in=w10) -> ("String"=w11, "Value"=w12)
              Is Equal(x=w12, y=w9) -> w13
              stop if w13
            }
            Property Node(instance in=s2, "Part_type"=w11, "Part_size"=$Part_size) -> (instance out=w5)
            w3 = w1
            w4 = no error
          }
        }
      }
      frame "init" {
        $Tab <- "Task_window"
        Build Array(w1, ["get_parts_list", "get_alloys_list"]) -> w3
        w4 = no error
        w5 = s2
      }
      frame "load_part_image" {
        Concatenate Strings("Get_part_image?Part_name=", $Part_shape) -> w14
        Concatenate Strings("http://desktop-n8eovm3:80/WebUIService/", w14) -> w15
        Build Cluster(w15) -> w16
        $Cluster <- w16
        w3 = w1
        w4 = no error
        w5 = s2
      }
      frame "stop" {
        w3 = w1
        w4 = no error
        w5 = s2
      }
      frame "get_parts_list" {
        Concatenate Strings("http://desktop-n8eovm3:80/WebUIService/", "Get_parts_list") -> w17
        call "GET.gvi"(url=w17) -> (body=w18, error out=w19)
        Unflatten From Json(JSON string=w18, error in (no error)=w19, path=["Parts_list"], type and defaults=cluster{"String": string, "Value": string}[] []) -> (error out=w20, value=w21)
        Array Index(array=w21) -> (out0[_]=w22)
        Property Node(instance in=w22) -> ("Value"=w23)
        Property Node(instance in=reference to "Part_shape", "ItemsAndValues"=w21, "ValueSignaling"=w23, error in=w20) -> (error out=w24, instance out=w25)
        Close Reference(error in=w24, reference=w25) -> (error out=w4)
        w3 = w1
        w5 = s2
      }
      frame "get_alloys_list" {
        w3 = w1
        w4 = no error
        w5 = s2
      }
    }
    next s1 = w3
    next s2 = w5
    stop if FALSE
  }
  $"Error Out" <- w4
